# Dynamo graph PY - GPT4All_Chatbot_1_DynPlayer_.dyn (Dynamo 2.16.4.10216)

# group: Control Simple Chat bot use in Dynamo Player
chat_prompt = StringInput("Give me a brief introduction , of using Gpt4 all ,with Revit and Dynamo.")  # graph input
basic_chatbot_using_gpt4all = Python(IN[0]=chat_prompt)  # CPython3
# ---------- basic_chatbot_using_gpt4all.python (23 lines) ----------
# Load the Python Standard and DesignScript Libraries
import sys
import clr
clr.AddReference('ProtoGeometry')
from Autodesk.DesignScript.Geometry import *
import os
localapp = os.getenv(r'LOCALAPPDATA')

sys.path.append(os.path.join(localapp, r'python-3.9.12-embed-amd64\Lib\site-packages'))

import gpt4all 

# The inputs to this node will be stored as a list in the IN variables.
chatinput = IN[0]

# Place your code below this line
from gpt4all import GPT4All
model = GPT4All("Meta-Llama-3-8B-Instruct.Q4_0.gguf") # downloads / loads a 4.66GB LLM
with model.chat_session():
    result = model.generate(chatinput, max_tokens=1024)
    #print(model.generate(chatinput, max_tokens=1024))
# Assign your output to the OUT variable.
OUT = result
# ----------------------------------------
output = Watch(basic_chatbot_using_gpt4all)  # graph output
