# Dynamo graph PY - GPT4All_Chatbot_2_UI_History.dyn (Dynamo 2.16.4.10216)
# author: neel.shah.gbim@gmail.com
# Chat bot using GPT4ALL LLM Python Library

# group: Control - *OkCheck* Chat bot with UI - with History
boolean = BoolSelector(true)
system_prompt = Python()  # CPython3
# ---------- system_prompt.python (36 lines) ----------
# Load the Python Standard and DesignScript Libraries
import sys
import clr
clr.AddReference('ProtoGeometry')
from Autodesk.DesignScript.Geometry import *

# The inputs to this node will be stored as a list in the IN variables.


# Place your code below this line
systemprompt = """

System Prompt: You are an expert Revit assistant with deep knowledge of Revit 2023+ and its interface. Your role is to assist users in learning, understanding, and navigating Revit, answering questions related to tools, commands, features, and best practices.

When a user asks for help:
1. Provide clear, concise, and actionable solutions.
2. Offer step-by-step instructions if needed for specific tasks.
3. Be patient and friendly, guiding the user through the process.
4. Always ensure to explain the interface and commands in a way that a beginner or intermediate user can understand.

Your responses should aim to empower the user to solve their problems and learn how to navigate Revit more efficiently.

Key focus areas include:
- Understanding the Revit user interface (UI)
- Navigating the Ribbon, Properties Palette, and Project Browser
- Using essential Revit tools (e.g., creating walls, floors, and elements)
- Troubleshooting common issues
- Explaining workflows, project management, and family creation
- Offering best practices for modeling, documentation, and collaboration in Revit

Be sure to suggest keyboard shortcuts or tips to improve productivity whenever applicable.

"""

# Assign your output to the OUT variable.
OUT = systemprompt
# ----------------------------------------
okcheck_chat_bot_with_ui_with = Python(IN[0]=boolean, IN[1]=system_prompt)  # "*OkCheck* Chat bot with UI - with History"; CPython3
# ---------- okcheck_chat_bot_with_ui_with.python (205 lines) ----------
"""
Author: Neel Shah
Email: neel.shah.gbim@gmail.com
GitHub: https://github.com/kneelster111/LLMs-with-Autodesk-Dynamo-Python

This project is licensed under the Creative Commons Attribution-Noncommercial (CC BY-NC) license, allowing modification and redistribution for non-commercial purposes only, with attribution to the original author. The code is experimental and provided "as is" with no warranty. Use at your own risk.
"""

# Import necessary Dynamo and Revit modules
import clr
clr.AddReference('RevitServices')
from RevitServices.Persistence import DocumentManager
from RevitServices.Transactions import TransactionManager

import sys
import os

localapp = os.getenv(r'LOCALAPPDATA')

sys.path.append(os.path.join(localapp, r'python-3.9.12-embed-amd64\Lib\site-packages'))

import System
import System.Drawing
import System.Windows.Forms
import time

import gpt4all
from gpt4all import GPT4All

# The inputs to this node will be stored as a list in the IN variables.
#resfresh, revitdata, modelname, system_prompt = IN
# Signal the refresh input from Dynamo
refresh = IN[0]

systemprompt=IN[1]


# Initialize client for the selected model
model = GPT4All("Meta-Llama-3-8B-Instruct.Q4_0.gguf")  # Loads the model

class ChatForm(System.Windows.Forms.Form):
    def __init__(self):
        self.start_time = time.time()
        self.conversation_history = []  # Initialize conversation history
        self.InitializeComponent()
        self.code_executed_correctly = False

    def InitializeComponent(self):
        self.Text = "Dynamo AI Chat App"
        self.Size = System.Drawing.Size(600, 900)
        self.toolTip = System.Windows.Forms.ToolTip()
        self.StartPosition = System.Windows.Forms.FormStartPosition.CenterScreen
        self.FormBorderStyle = System.Windows.Forms.FormBorderStyle.Sizable
        self.MaximizeBox = True
        self.MinimizeBox = True

        # Chat history window
        self.chatHistory = System.Windows.Forms.RichTextBox()
        self.chatHistory.Location = System.Drawing.Point(10, 10)
        self.chatHistory.Size = System.Drawing.Size(570, 400)
        self.chatHistory.ReadOnly = True
        self.chatHistory.BorderStyle = System.Windows.Forms.BorderStyle.Fixed3D

        # Chat input window
        self.chatInput = System.Windows.Forms.RichTextBox()
        self.chatInput.Multiline = True
        self.chatInput.Location = System.Drawing.Point(10, 420)
        self.chatInput.Size = System.Drawing.Size(570, 100)
        self.chatInput.BorderStyle = System.Windows.Forms.BorderStyle.Fixed3D
        self.chatInput.KeyDown += self.ChatInputKeyDown

        # Send button
        self.sendButton = System.Windows.Forms.Button()
        self.sendButton.Text = "Send"
        self.sendButton.Size = System.Drawing.Size(110, 25)
        self.sendButton.Click += self.SendButtonClick
        # Tooltip for chat input
        self.toolTip.SetToolTip(self.chatInput, "Type your message here. Press Ctrl + Enter to send.")


        # Save button
        self.saveButton = System.Windows.Forms.Button()
        self.saveButton.Text = "Save"
        self.saveButton.Size = System.Drawing.Size(110, 25)
        self.saveButton.Click += self.SaveButtonClick
        # Tooltip for save button
        self.toolTip.SetToolTip(self.saveButton, "This will save the chat history as a txt file.")


        # Time taken label
        self.timeLabel = System.Windows.Forms.Label()
        self.timeLabel.Size = System.Drawing.Size(130, 25)

        # FlowLayoutPanel for buttons at the bottom
        self.bottomPanel = System.Windows.Forms.FlowLayoutPanel()
        self.bottomPanel.Dock = System.Windows.Forms.DockStyle.Bottom
        self.bottomPanel.FlowDirection = System.Windows.Forms.FlowDirection.LeftToRight
        self.bottomPanel.WrapContents = False
        self.bottomPanel.AutoSize = True
        self.bottomPanel.Padding = System.Windows.Forms.Padding(10)

        # Add the controls for sending messages and running the code agent into the bottom panel
        self.bottomPanel.Controls.Add(self.sendButton)
        self.bottomPanel.Controls.Add(self.saveButton)


        # Adding all the main UI components
        self.Controls.Add(self.chatHistory)
        self.Controls.Add(self.chatInput)
        self.Controls.Add(self.bottomPanel)  # This contains all the buttons now
        self.Controls.Add(self.timeLabel)


        # Style enhancements (basic)
        self.BackColor = System.Drawing.Color.White
        self.chatHistory.BackColor = System.Drawing.Color.WhiteSmoke
        self.chatInput.BackColor = System.Drawing.Color.WhiteSmoke
        self.sendButton.BackColor = System.Drawing.Color.LightGray
        self.sendButton.ForeColor = System.Drawing.Color.Black
        
        # Define the system prompt
        self.system_prompt = systemprompt

        # Add the system prompt to the conversation history and chat history
        self.chatHistory.AppendText(self.system_prompt + "\n")
        self.conversation_history.append(self.system_prompt)
        # Set the chatInput as the default focus
        self.chatInput.Focus()

        # Handle resize event
        self.Resize += self.OnResize

    def OnResize(self, sender, EventArgs):
        self.chatHistory.Size = System.Drawing.Size(self.ClientSize.Width - 20, self.ClientSize.Height - 200)
        self.chatInput.Location = System.Drawing.Point(10, self.ClientSize.Height - 170)
        self.chatInput.Size = System.Drawing.Size(self.ClientSize.Width - 20, 100)
        self.bottomPanel.Location = System.Drawing.Point(10, self.ClientSize.Height - 80)
        self.timeLabel.Location = System.Drawing.Point(self.ClientSize.Width - 150, self.ClientSize.Height - 60)
        
    def ChatInputKeyDown(self, sender, event):
        if event.Control and event.KeyCode == System.Windows.Forms.Keys.Enter:
            self.SendButtonClick(sender, event)

    def SendButtonClick(self, sender, EventArgs):
        message = self.chatInput.Text
        if message:
            elapsed_time = time.time() - self.start_time
            minutes, seconds = divmod(elapsed_time, 60)
            time_taken_str = f"Time taken: {int(minutes)}m {int(seconds)}s"
            self.timeLabel.Text = time_taken_str
            
            try:
                int_value = int(self.intInput.Text)
                if not (1 <= int_value <= 20):
                    int_value = 5
            except ValueError:
                int_value = 5
            
            # Append user message to chat history
            self.chatHistory.AppendText(f"User: {message}\n")
            self.conversation_history.append(f"User: {message}")
            
            # Pass the conversation history to the model
            history = "\n".join(self.conversation_history)
            
            # Load and use the model
            #messages = [{"role": "user", "content": history}]
            #response = client.chat_completion(messages, max_tokens=1000)
            result = model.generate(history, max_tokens=1024)
            
            # Extract and format the response
            #if 'choices' in response:
                #result = response['choices'][0]['message']['content']
            #else:
                #result = "Sorry, I couldn't get a response."

            self.result = result
            
            # Append bot response to chat history
            self.chatHistory.AppendText(f"Bot: {result}\n")
            self.conversation_history.append(f"Bot: {result}")  # Add bot response to history
            
            self.chatInput.Clear()
            self.chatInput.Focus()


    def SaveButtonClick(self, sender, EventArgs):
        saveFileDialog = System.Windows.Forms.SaveFileDialog()
        saveFileDialog.Filter = "Text Files (*.txt)|*.txt|All Files (*.*)|*.*"
        
        if saveFileDialog.ShowDialog() == System.Windows.Forms.DialogResult.OK:
            with open(saveFileDialog.FileName, 'w') as file:
                file.write(self.chatHistory.Text)



    

def run():
    app = ChatForm()
    application = System.Windows.Forms.Application
    application.Run(app)

run()
OUT=0
# ----------------------------------------
output = Watch(okcheck_chat_bot_with_ui_with)  # graph output
