# Dynamo graph PY - HF_Chatbot_4_UI_Agent.dyn (Dynamo 2.16.4.10216)
# author: neel.shah.gbim@gmail.com
# Chat bot using GPT4ALL LLM Python Library

# group: Control
file_path = Filename(".\DynamoPY-huggingface_ui.py")
file_from_path = FileObject(path=file_path)
readText = FileSystem.ReadText(file=file_from_path)

# group: Control get all categories and model infomation
parameters = Element.Parameters()  # unwired: element
python_script = Python()  # IronPython2; graph input
# ---------- python_script.python (25 lines) ----------
import clr
clr.AddReference('RevitAPI')
from Autodesk.Revit.DB import *
clr.AddReference('RevitServices')
from RevitServices.Persistence import DocumentManager

# Get the current document
doc = DocumentManager.Instance.CurrentDBDocument

# Access Categories
categories = doc.Settings.Categories

# Initialize lists to store model and annotation category names
model_categories = []
annotation_categories = []

# Iterate over all categories and separate them into model and annotation
for cat in categories:
    if cat.CategoryType == CategoryType.Model:
        model_categories.append(cat.Name)
    elif cat.CategoryType == CategoryType.Annotation:
        annotation_categories.append(cat.Name)

# Output both model and annotation categories
OUT = model_categories, annotation_categories
# ----------------------------------------
byName = Category.ByName(name=python_script)
code_block = CodeBlock(x=byName) { x[0]; x[1]; }
code_block_2 = CodeBlock(revitCategories=code_block.out0, Categoryname=code_block.out1) { revitCategories; Categoryname; }
all_elements_of_category = ElementsOfCategory(Category=code_block_2.revitCategories)
code_block_3 = CodeBlock(elements=all_elements_of_category) { elements; elements2 = List.Flatten(elements, -1); }
function_apply = ApplyFunction(function=parameters, argument0=code_block_3.elements2)
string_from_array = FromArray(array=function_apply)
watch = Watch(string_from_array)

# group: Control
boolean = BoolSelector(true)
string = StringInput("Qwen/Qwen2.5-Coder-32B-Instruct")
py_system_prompt = Python()  # CPython3
# ---------- py_system_prompt.python (31 lines) ----------
# Load the Python Standard and DesignScript Libraries
import sys
import clr
clr.AddReference('ProtoGeometry')
from Autodesk.DesignScript.Geometry import *

# The inputs to this node will be stored as a list in the IN variables.

# Place your code below this line
system_prompt = """
System Prompt: You are an expert Revit assistant and Dynamo Python Code Agent. Your role is to assist with tasks related to Revit 2023+ and Dynamo, leveraging CPython 3.9. You should always provide solutions in a professional and clear manner.

The format for user requests, assistant responses, and code output must follow the structure outlined below:

1. **User** / **Bot** / **CodeAgent**: ## The task or the assistant's response.
2. **Code**: The Python code that addresses the task. The code should always include the necessary imports and libraries, including the default `clr` import for Dynamo scripting.

Example:

User: "How can I create a new wall in Revit using Dynamo?"
Bot: "Here is the Python script for creating a new wall in Revit using Dynamo:"
Code:
```python
## Python code goes here ##
import clr
```<end_action> 

Ensure all code is encapsulated in triple backticks for clarity. The response should be clear, concise, and focused on solving the user's problem.
"""
# Assign your output to the OUT variable.
OUT = system_prompt
# ----------------------------------------
python_script_from_string = PythonStringNode(script=readText, IN[0]=boolean, IN[1]=watch, IN[2]=string, IN[3]=py_system_prompt)  # CPython3
output = Watch(python_script_from_string)  # graph output
