# Dynamo graph PY - InstallCustomPythonModules.dyn (Dynamo 2.16.4.10216)

# group: Input - string input for the python modules you want to import
string = StringInput("smolagents.agents")
code_block = CodeBlock { ","; }
split = String.Split(string=string, separator0=code_block)

# group: Control PY - install custom python modules.
py_install_custom_python_modules = Python(IN[0]=split)  # CPython3
# ---------- py_install_custom_python_modules.python (110 lines) ----------
# More info here
# https://github-wiki-see.page/m/DynamoDS/Dynamo/wiki/Customizing-Dynamo%27s-Python-3-installation
import sys
import clr
import System
import re

# Print system paths
print('\n'.join(sys.path))

# Get Python engine name
pyEngineName = sys.implementation.name 

# Add reference to Windows Forms
clr.AddReference("System.Windows.Forms")
import System.Windows.Forms
from System.Windows.Forms import MessageBox, MessageBoxButtons, MessageBoxIcon

# Load DynamoCore assembly and get version
from System.Reflection import Assembly
dynamo = Assembly.Load('DynamoCore')
dynamo_version = str(dynamo.GetName().Version)
dynamo_version = tuple(int(x) for x in dynamo_version.split("."))
print('dynamo_version', dynamo_version)

init_setup = False

# Check if Python engine is not IronPython and Dynamo version is greater than 2.8.0.0
if pyEngineName != "ironpython" and dynamo_version > (2, 8, 0, 0):
    clr.AddReference('Python.Included')
    import Python.Included as pyInc
    path_py3_lib = pyInc.Installer.EmbeddedPythonHome
    import platform, os, subprocess, importlib.util
    from System import Environment
    from System.Net import WebClient

    # Get paths
    assert os.path.isdir(path_py3_lib)
    pipDirPath = os.path.join(path_py3_lib, 'Scripts')
    pipfilePath = pipDirPath + "\\pip"
    get_pip_path = os.path.join(path_py3_lib, 'get-pip.py')
    site_packagepath = os.path.join(path_py3_lib, 'Lib\\site-packages')
    lib_path = os.path.join(path_py3_lib, 'Lib')

    # Download get-pip.py if not present
    if not os.path.isfile(get_pip_path):
        client = WebClient()
        client.DownloadFile('https://bootstrap.pypa.io/get-pip.py', get_pip_path)

    filepy_pth = f'python{sys.version_info.major}{sys.version_info.minor}._pth'
    pthFilePath = os.path.join(path_py3_lib, filepy_pth)
    assert os.path.isfile(pthFilePath), f"Error file {pthFilePath} not found"

    # Update pthFilePath
    with open(pthFilePath, 'r+') as f:
        lines = f.readlines()
        for idx, line in enumerate(lines):
            if re.match(r'#import site', line):
                lines[idx] = re.sub(r'#', '', line)
                f.writelines(lines)
                break
        # Add site-packages
        if re.search(r'./Lib/site-packages', lines[-1]) is None:
            f.write("\n./Lib/site-packages")

    # Install pip if not installed
    if not os.path.isdir(pipDirPath):
        print(f'installing pip in local Python environment: {path_py3_lib}')
        subprocess.Popen(["python", get_pip_path])
        try:
            subprocess.Popen(["python", '-m', pipfilePath, 'install', '--upgrade pip'], cwd=path_py3_lib)
        except Exception as ex:
            print(str(ex))
        init_setup = True
        MessageBox.Show("Initialization in Progress...\nWhen installation finished, close Dynamo and relaunch this script to install packages", "Initialization In Progress...", MessageBoxButtons.OK, MessageBoxIcon.Warning)
        raise Exception("close Dynamo and relaunch this script to install packages")
    else:
        print('pip was already installed for this local Python environment')
        init_setup = False

    # Install packages
    installPackages = IN[0]
    dict_result = {"out": [], "error_warning": []}
    if installPackages and not init_setup:
        sys.path.append(site_packagepath)
        sys.path.append(lib_path)
        for packageName in installPackages:
            spec = importlib.util.find_spec(packageName)
            if spec is None:
                try:
                    result = subprocess.run([pipfilePath, "install", '--target=' + site_packagepath, packageName], capture_output=True, cwd=path_py3_lib)
                    dict_result["out"].append(result.stdout.decode('utf-8'))
                    dict_result["error_warning"].append(result.stderr.decode('utf-8'))
                except Exception as ex:
                    dict_result["error_warning"].append(f'error while installing {packageName}, {ex}')
            else:
                dict_result["out"].append(f"package {packageName} is already installed")

        # Check result
        if False:
            import numpy as np
            import pandas as pd
        MessageBox.Show("Python Installation and Configuration completed successfully!", "Python Installation", MessageBoxButtons.OK, MessageBoxIcon.Information)
        OUT = dict_result, None

elif pyEngineName == "ironpython" and dynamo_version > (2, 8, 0, 0):
    MessageBox.Show("Switch this node to the CPython3 engine and then rerun the script!", "Python Installation", MessageBoxButtons.OK, MessageBoxIcon.Warning)

else:
    MessageBox.Show("Python Installation and Configuration completed successfully!", "Python Installation", MessageBoxButtons.OK, MessageBoxIcon.Information)
# ----------------------------------------
watch = Watch(py_install_custom_python_modules)

# group: Control - get sys path and version
py_ys_path_sys_version = Python()  # CPython3
# ---------- py_ys_path_sys_version.python (7 lines) ----------
# Load the Python Standard and DesignScript Libraries
import sys
import clr
clr.AddReference('ProtoGeometry')
from Autodesk.DesignScript.Geometry import *

OUT= sys.path,sys.version
# ----------------------------------------
watch_2 = Watch(py_ys_path_sys_version)
